# Grasshopper definition infinity-mirror-hex.gh (Grasshopper 1.0.7)

number_slider = Slider(48, range=0..100)
pt = Point(Point(0, 0, 0))
wall_thickness = Slider(2, range=0..10)
addition = Addition(A=number_slider, B=wall_thickness)
number_slider_2 = Slider(71, range=0..100)
number_slider_3 = Slider(6, range=0..10)
wall_height = Slider(12, range=0..20)
circle = CircleCNR(Center=pt, Normal=Vector(0, 0, 1), Radius=addition)
circle_2 = CircleCNR(Center=pt, Normal=Vector(0, 0, 1), Radius=number_slider)
subtraction = Subtraction(A=number_slider_2, B=wall_thickness)
number_slider_4 = Slider(16, range=0..100)
polygon = Polygon(Plane=pt, Radius=number_slider_2, Segments=number_slider_3, FilletRadius=0)  # -> Polygon, Length
polygon_2 = Polygon(Plane=pt, Radius=subtraction, Segments=number_slider_3, FilletRadius=0)  # -> Polygon, Length
divide = DivideCurve(Curve=polygon.Polygon, Count=Slider(12, range=0..12), Kinks=False)  # -> Points, Tangents, Parameters
boundary = BoundarySurfaces(Edges=[circle_2, circle])
boundary_2 = BoundarySurfaces(Edges=[polygon.Polygon, circle_2])
boundary_3 = BoundarySurfaces(Edges=[polygon.Polygon, polygon_2.Polygon])
sift = SiftPattern(List=divide.Points, SiftPattern=[1, 0])  # -> Output0, Output1
number_slider_5 = Slider(5, range=0..10)
Z = UnitZ(Factor=Slider(8, range=0..100))
Z_2 = UnitZ(Factor=number_slider_4)
Z_3 = UnitZ(Factor=wall_height)
Z_4 = UnitZ(Factor=wall_thickness)
pt_2 = Point(sift.Output0)
base_srfc = Extrude(Base=boundary_2, Direction=Z_4)
walls = Extrude(Base=boundary_3, Direction=Z_3)
ln = Line(StartPoint=pt, EndPoint=pt_2)
extr = Extrude(Base=ln, Direction=Z)
multiplication = Multiplication(A=number_slider_5, B=-1)
boundary_4 = BoundarySurfaces(Edges=circle)
boxrec = BoxRectangle(Rectangle=extr, Height=number_slider_5)
boxrec_2 = BoxRectangle(Rectangle=extr, Height=multiplication)
Z_5 = UnitZ(Factor=number_slider_4)
extr_2 = Extrude(Base=boundary_4, Direction=Z_5)
sunion = SolidUnion(Breps=[boxrec_2, boxrec])
join = BrepJoin(Breps=[base_srfc, walls, sunion])  # -> Breps, Closed
ring = Extrude(Base=boundary, Direction=Z_2)
